# Dynamo graph MatchDataBasedOnLocation.dyn (Dynamo 2.0.3.8810)

select_model_elements = DSModelElementsSelection()  # 1785 picked in the model
convertToAPIElement = MonkeyJobNodes.DocOperations.ConvertToAPIElement(directShape=select_model_elements)
removeNulls = Lists.Manage.RemoveNulls(Data=convertToAPIElement.BoundingBox)
file_path = Filename("No file selected.")
removeNulls_2 = Lists.Manage.RemoveNulls(Data=convertToAPIElement.RevitApiElement)
removeItemAtIndex = List.RemoveItemAtIndex(list=convertToAPIElement.ElementID, indices=removeNulls_2.Indices)
removeNulls_3 = Lists.Manage.RemoveNulls(Data=convertToAPIElement.CenterBoundingBox)
python_script = Python(IN[0]=removeItemAtIndex, IN[1]=removeNulls_3.Cleaned)
# ---------- python_script.python (18 lines) ----------
# Enable Python support and load DesignScript library
import clr
clr.AddReference('ProtoGeometry')
from Autodesk.DesignScript.Geometry import *

# The inputs to this node will be stored as a list in the IN variables.
dataEnteringNode = IN

# Place your code below this line

Ids = IN[0]

Center = IN[1]

OUT = []
for i, x in enumerate(Ids):
	temp = str(Ids[i]) + "," + str(Center[i])
	OUT.append(temp)
# ----------------------------------------
watch = Watch(python_script)
writeText = FileSystem.WriteText(filePath=file_path, text=watch)
